# Grasshopper definition S15_Grid_To_Map.ghx (Grasshopper 1.0.9)

path = FilePath("/Users/ella/Documents/ARCH 6131/2026/class 9/lots_grid.csv")
file = ReadFile(File=path, PerLineParse=True)
split = SplitList(List=file, Index="1")  # -> ListA, ListB
split_2 = TextSplit(Text=split.ListA, Separators=",")
split_3 = TextSplit(Text=split.ListB, Separators=",")  # -> simplify(Result)
panel = Panel(split_3)
panel_2 = Panel(split_2)
flip = FlipMatrix(Data=split_3)
bang = ExplodeTree(Data=flip)  # -> Branch0, Branch1, Branch2, Branch3, Branch4
m_objects = QueryModelObjects(Layer="Grid Anchor", Locked=True, Hidden=True, Selected=False, AutoUpdateState=True)
bbl = Text(bang.Branch0)
num_buildings = Number(bang.Branch1)
coverage_percentage = Number(bang.Branch3)
avg_bldg_height = Number(bang.Branch2)
number_slider = Slider(10, range=5..25)
m_objects_2 = QueryModelObjects(Layer="Map Anchor", Locked=True, Hidden=True, Selected=False, AutoUpdateState=True)
Y = UnitY(Factor=Slider(-1000, range=-5000..-1000))
object = ModelObject(Object=m_objects_2)  # -> Object, Geometry, Name, Layer, Visibility, Display, Drafting, Section, Render
move = Move(Geometry=m_objects, Motion=Y)  # -> Geometry, Transform
panel_3 = Panel(m_objects)
panel_4 = Panel(m_objects_2)
concat = Concatenate(FragmentA="BBL:  ", FragmentB=bbl)
panel_5 = Panel(object.Geometry)
tag = TextTag3D(Location=move.Geometry, Text=concat, Size=number_slider, Justification=7)
Y_2 = UnitY(Factor=Slider(-1250, range=-5000..-1000))
move_2 = Move(Geometry=m_objects, Motion=Y_2)  # -> Geometry, Transform
concat_2 = Concatenate(FragmentA="Number of Buildings: ", FragmentB=num_buildings)
tag_2 = TextTag3D(Location=move_2.Geometry, Text=concat_2, Size=number_slider, Justification=7)
panel_6 = Panel(object.Name)
mindex = MemberIndex(Set=object.Name, Member=bbl)  # -> Index, Count
item = ListItem(List=object.Geometry, Index=mindex.Index, Wrap=True)  # -> flatten(Item)
ln = Line(StartPoint=m_objects, EndPoint=item)
Y_3 = UnitY(Factor=Slider(-1750, range=-5000..-1000))
Y_4 = UnitY(Factor=Slider(-1500, range=-5000..-1000))
move_3 = Move(Geometry=m_objects, Motion=Y_3)  # -> Geometry, Transform
panel_7 = Panel(mindex.Index)
move_4 = Move(Geometry=m_objects, Motion=Y_4)  # -> Geometry, Transform
concat_3 = Concatenate(FragmentA="Average Footprint Coverage: ", FragmentB=coverage_percentage)
concat_4 = Concatenate(FragmentA="Average Building Height: ", FragmentB=avg_bldg_height)
tag_3 = TextTag3D(Location=move_3.Geometry, Text=concat_3, Size=number_slider, Justification=7)
tag_4 = TextTag3D(Location=move_4.Geometry, Text=concat_4, Size=number_slider, Justification=7)
panel_8 = Panel(mindex.Count)
